# Dynamo graph GetAllViews with pydynamo.dyn (Dynamo 2.19.3.6394)

boolean = BoolSelector(true)
python_script = Python(IN[0]=boolean)  # IronPython3
# ---------- python_script.python (132 lines) ----------
# by onBIM Technology
# www.onbim.net
# file name: ./python/pydynamo test.py

# REFERENCES AND IMPORTS
# BEGIN>>>>>

import clr
import System
import sys

# <<< Python Modules >>>
# BEGIN

# Import traceback module from Iron Python
import traceback

# END

# Import System Libraries
clr.AddReference("System.Core")
from System.Collections.Generic import List as SystemList

# Import Linq
clr.ImportExtensions(System.Linq)

# Import Dynamo Library Nodes - Geometry
clr.AddReference('ProtoGeometry')
from Autodesk.DesignScript import Geometry as DynamoGeometry

# Import Dynamo Library Nodes - Core
clr.AddReference('DSCoreNodes')
from DSCore import List as DynamoList

# Import Dynamo Library Nodes - Core
clr.AddReference('DSCoreNodes')
from DSCore import Color as DynamoColor

# Import Dynamo Geometry Color
# https://forum.dynamobim.com/t/geometrycolor-bygeometrycolor-inside-python/52724
clr.AddReference('GeometryColor')
from Modifiers import GeometryColor as DynamoGeometryColorize

# Import Dynamo Library Nodes - Revit
clr.AddReference("RevitNodes")
import Revit as RevitNodes

# Import ToDSType(bool) extension method
clr.ImportExtensions(RevitNodes.Elements)
clr.ImportExtensions(RevitNodes.GeometryConversion)

# Import DocumentManager and TransactionManager
clr.AddReference("RevitServices")
import RevitServices
from RevitServices.Persistence import DocumentManager
from RevitServices.Transactions import TransactionManager

# Import Revit API
clr.AddReference("RevitAPI")
import Autodesk
from Autodesk.Revit.DB import *

# Import Revit User Interface API
clr.AddReference("RevitAPIUI")
from Autodesk.Revit.UI import *

# Import Revit IFC API
# https://forum.dynamobim.com/t/ifcexportutils/4833/7?u=ricardo_freitas
clr.AddReference('RevitAPIIFC')
from Autodesk.Revit.DB.IFC import *

# Import Dynamo Services
clr.AddReference('DynamoServices')
from Dynamo import Events as DynamoEvents

# Active Dynamo Workspace Path
workspaceFullPath = DynamoEvents.ExecutionEvents.ActiveSession.CurrentWorkspacePath
workspacePath = '\\'.join(workspaceFullPath.split('\\')[0:-1])

# Import pydynamo
pydynamoPath = workspacePath + "\\pydynamo"
sys.path.append(pydynamoPath)
import pydynamo as pydyn

# REFERENCES AND IMPORTS
# END<<<<<

# FUNCTIONS
# BEGIN>>>>>

# <<< Your classes and functions here >>>

# FUNCTIONS
# END<<<<<

# INPUTS AND VARIABLES DECLARATIONS
# BEGIN>>>>>

doc = DocumentManager.Instance.CurrentDBDocument

inputFromDynamo = IN[0]

result = []

# INPUTS AND VARIABLES DECLARATIONS
# END<<<<<

# MAIN CODE
# BEGIN>>>>>

try:
    errorReport = None
    
    pydyn.RevitTaskDialog(_MainContent=pydyn.HelloWorld())
    
    result = [
        inputFromDynamo,
        pydyn.PyDynamoVars.RevitVersionName,
        pydyn.PyDynamoVars.RevitVersionNumber
    ]

except Exception as e:
    # if error occurs anywhere in the process catch it
    errorReport = traceback.format_exc()

# Assign your output to the OUT variable
if errorReport is None:
    OUT = result
else:
    OUT = errorReport
# MAIN CODE
# END<<<<<
# ----------------------------------------
