# Dynamo graph truss.dyn (Dynamo 2.19.3.6394)

byCoordinates = Point.ByCoordinates()
number_slider = DoubleSlider(10.125, range=0..100 step 0.1)
number_slider_2 = DoubleSlider(2.871, range=0..100 step 0.1)
byCoordinates_2 = Point.ByCoordinates(x=number_slider, y=number_slider_2)
number_slider_3 = DoubleSlider(20.251, range=0..100 step 0.1)
number_slider_4 = DoubleSlider(-4.536, range=-4.536..100 step 0.1)
byCoordinates_3 = Point.ByCoordinates(x=number_slider_3, y=number_slider_4)
number_slider_5 = DoubleSlider(29.96, range=0..100 step 0.1)
number_slider_6 = DoubleSlider(-1.875, range=-3.275..100 step 0.1)
byCoordinates_4 = Point.ByCoordinates(x=number_slider_5, y=number_slider_6)
number_slider_7 = DoubleSlider(47, range=0..100 step 0.1)
byCoordinates_5 = Point.ByCoordinates(x=number_slider_7)
list_create = List.Create(item0=byCoordinates, item1=byCoordinates_2, item2=byCoordinates_3, item3=byCoordinates_4, item4=byCoordinates_5)

# group: INPUT
# note: Banzo Superior
byPoints = NurbsCurve.ByPoints(points=list_create)

# group: INPUT
# note: Número de Montantes
nMontantes = IntegerSlider(23, range=5..100 step 1)

# note: Gera Lista de Parâmetros
code_block = CodeBlock(nMontantes=nMontantes) { 0..1..#nMontantes; }
# note: Pontos Superiores
pointAtParameter = Curve.PointAtParameter(curve=byPoints, param=code_block)
ZAxis = Vector.ZAxis()
reverse = Vector.Reverse(vector=ZAxis)

# group: INPUT
# note: Altura da Treliça
number_slider_8 = DoubleSlider(5, range=0.5..5 step 0.1)

# group: OUTPUT
# note: Banzo Inferior
translate = Geometry.Translate(geometry=byPoints, direction=reverse, distance=number_slider_8)

# note: Pontos Inferiores
pointAtParameter_2 = Curve.PointAtParameter(curve=translate, param=code_block)

# group: OUTPUT
# note: Montantes
byStartPointEndPoint = Line.ByStartPointEndPoint(startPoint=pointAtParameter, endPoint=pointAtParameter_2)

count = List.Count(list=byStartPointEndPoint)
code_block_2 = CodeBlock(nMontantes=count)
# ---------- code_block_2.designscript (5 lines) ----------
// Indexes start points
0..nMontantes-2;

// Indexes end points
1..nMontantes-1;
# ----------------------------------------
# note: Start Points das diagonais
getItemAtIndex = List.GetItemAtIndex(list=pointAtParameter, index=code_block_2.out0)
# note: End Points das diagonais
getItemAtIndex_2 = List.GetItemAtIndex(list=pointAtParameter_2, index=code_block_2.out1)

# group: OUTPUT
# note: Diagonais
byStartPointEndPoint_2 = Line.ByStartPointEndPoint(startPoint=getItemAtIndex, endPoint=getItemAtIndex_2)

code_block_3 = CodeBlock { 2; }
code_block_4 = CodeBlock(nMontantes=code_block_3) { 0..1..#nMontantes; }

# group: INPUT
# note: Altura da Treliça
number_slider_9 = DoubleSlider(2.7, range=0.5..5 step 0.1)

# group: INPUT
# note: Número de Montantes
nMontantes_2 = IntegerSlider(57, range=-1..100 step 1)

python_script = Python(IN[0]=byPoints, IN[1]=number_slider_9, IN[2]=nMontantes_2)  # CPython3
# ---------- python_script.python (121 lines) ----------
# by onBIM Technology
# www.onbim.net
# file name: ./Aula 004/truss.py

import clr
import traceback

# Import Dynamo Library Nodes - Geometry
clr.AddReference('ProtoGeometry')
from Autodesk.DesignScript import Geometry as DynamoGeometry

def ValidateInteger(number, mustBePositive=False):
    if not isinstance(number, int):
        raise ValueError("n precisa ser um número inteiro")
        
    if mustBePositive and number < 0:
        raise ValueError("n precisa ser positivo")

def GeraListaDeParametros(n):
    ValidateInteger(n, True)
    
    if n == 0 or n == 1:
        return 0
    
    i = 0
    divisor = 1 / (n - 1)
    
    pars = []
    while i < n:
        pars.append(i * divisor)
        i = i + 1
    
    return pars

def GeraPontosNoBanzo(curva, nPontos):
    ValidateInteger(nPontos, True)
    
    if nPontos < 2:
        raise ValueError("O número de pontos precisa ser maior que 1")
    
    # Obtém os parâmetros
    parameters = GeraListaDeParametros(nPontos)
    
    # Retorna os pontos
    return [
        DynamoGeometry.Curve.PointAtParameter(curva,p)
        for p in parameters
    ]

def CriaOsMontantes(startPoints, endPoints):
    if len(startPoints) != len(endPoints):
        raise ValueError("As duas listas têm que ter o mesmo comprimento")
    
    return [
        DynamoGeometry.Line.ByStartPointEndPoint(start, end)
        for start, end in zip(startPoints, endPoints)
    ]

def CriaAsDiagonais(startPoints, endPoints):
    # TODO: criar função isso
    if len(startPoints) != len(endPoints):
        raise ValueError("As duas listas têm que ter o mesmo comprimento")
    
    # obtém start points das diagonais
    diagStartPoints = startPoints[:-1]
    
    diagEndPoints = endPoints[1:]
    
    return [
        DynamoGeometry.Line.ByStartPointEndPoint(start, end)
        for start, end in zip(diagStartPoints, diagEndPoints)
    ]

banzoSuperior = IN[0]
hTruss = IN[1] # Altura da treliça
nMontantes = IN[2] # Número de montantes

# Variável de output
result = []

try:
    errorReport = None
    
    # Obtém o banzo inferior
    zAxis = DynamoGeometry.Vector.ZAxis()
    zAxisReverse = DynamoGeometry.Vector.Reverse(zAxis)
    
    banzoInferior = DynamoGeometry.Geometry.Translate(
        banzoSuperior,
        zAxisReverse,
        hTruss
    )
    
    # Obtém pontos do Banzo Superior
    pontosBanzoSup = GeraPontosNoBanzo(banzoSuperior, nMontantes)
    pontosBanzoInf = GeraPontosNoBanzo(banzoInferior, nMontantes)
    
    # Obtém os Montantes
    montantes = CriaOsMontantes(pontosBanzoSup, pontosBanzoInf)
    
    # Obtém as Diagonais
    diagonais = CriaAsDiagonais(pontosBanzoSup, pontosBanzoInf)
    
    result = {
        "Banzo Superior" : banzoSuperior,
        "Banzo Inferior" : banzoInferior,
        "Pontos Banzo Sup" : pontosBanzoSup,
        "Pontos Banzo Inf" : pontosBanzoInf,
        "Montantes" : montantes,
        "Diagonais" : diagonais
    }
    
except Exception as e:
    # if error occurs anywhere in the process catch it
    errorReport = traceback.format_exc()

# Assign your output to the OUT variable
if errorReport is None:
    OUT = result
else:
    OUT = errorReport
# ----------------------------------------
values = DesignScript.Builtin.Dictionary.Values(dictionary=python_script)
